# Grasshopper definition dhour_basics.gh (Grasshopper 0.9.14)
# plug-ins: Dhour

panel = Panel("""dry_bulb_temp
rel_humid""")
panel_2 = Panel("""2.2
3.3""")
rel_humid = Panel("""45
45
48""")
hour_number = Panel("""1
2
3""")
dry_bulb_temp = Panel("""22.0
24.5
26.2""")
# BASIC DHOUR CONSTRUCTION: A Dhour (data hour) holds two pieces of information:
# * an integer indicating an hour of the year.
# * a dictionary that holds any number of key-value pairs.
# 
# This collection of components demonstrates the construction of a single Dhour from these basic parts.
dhour = ConstructHour(HourNumber=Slider(2558, range=0..8759), Keys=panel, Values=panel_2)
entwine = Entwine(Branch00=hour_number, Branch01=dry_bulb_temp, Branch02=rel_humid)
flip = FlipMatrix(Data=entwine)
dhr = DataHour(dhour)
dhour_2 = DecomposeHour(DHour=dhour)  # -> HourNumber, Keys, Values, Color, Posistion
panel_3 = Panel(flip)
panel_4 = Panel(dhr)
panel_5 = Panel(dhour_2.HourNumber)
panel_6 = Panel(dhour_2.Keys)
panel_7 = Panel(dhour_2.Values)
panel_8 = Panel(dhour_2.Color)
panel_9 = Panel(dhour_2.Posistion)
getkeys = GetKeys(DHours=dhr)  # -> CommonKeys, OrphanKeys
# EXTRACTING INFORMATION: A dhour may be quiered for the keys and values it holds, using the "GetKeys" and "GetVal" components.  To use the latter, you must first know what keys are available.  If you don't know what keys a collection of dhours has available, try right-clicking on the dhour parameter component (to the left).
# 
# This collection of components demonstrates the extraction of information from a dhour.
panel_10 = Panel("dry_bulb_temp")
panel_11 = Panel(getkeys.CommonKeys)
getval = GetValue(Dhour=dhr, ValueKey=panel_10)  # -> Value, Range
panel_12 = Panel(getval.Value)
