# Grasshopper definition spatialization - heatmap.gh (Grasshopper 0.9.14)
# plug-ins: Dhour

oakland_epw = DataHour([{hr="0", color_r="96", color_g="96", color_b="255", color_a="255", pos_x="1.001366", pos_y="-0.637647", pos_z="0", is_surrogate="False", keys="et_rad_horz,et_rad_norm,global_horz_irrad,direct_norm_irrad,diffuse_horz_irrad,global_horz_illum,direct_norm_illum,diffuse_horz_illum,zenith_luminance,total_sky_cvr,opaque_sky_cvr,dry_bulb_temp,dew_point_temp,relative_humidity,pressure,wind_dir,wind_speed,horz_visibility,ceiling_height,precipt_water,aerosol_depth,snow_depth,days_since_snow,solar_altitude,solar_azimuth,sun_is_up,absolute_humidity", values="0,0,0,0,0,999900,999900,999900,99990,0,0,5.7,4.5,92,101430,40,1.9,24.1,77777,0,0,0,88,-1.309197,6.092528,0,655.0204"}, {hr="1", color_r="83", color_g="83", color_b="255", color_a="255", pos_x="1.002736", pos_y="-0.6329412", pos_z="0", is_surrogate="False", keys="et_rad_horz,et_rad_norm,global_horz_irrad,direct_norm_irrad,diffuse_horz_irrad,global_horz_illum,direct_norm_illum,diffuse_horz_illum,zenith_luminance,total_sky_cvr,opaque_sky_cvr,dry_bulb_temp,dew_point_temp,relative_humidity,pressure,wind_dir,wind_speed,horz_visibility,ceiling_height,precipt_water,aerosol_depth,snow_depth,days_since_snow,solar_altitude,solar_azimuth,sun_is_up,absolute_humidity", values="0,0,0,0,0,999900,999900,999900,99990,0,0,4.9,3.9,93,101230,30,2,24.1,77777,0,0,0,88,-1.257168,0.6658595,0,628.1306"}, {hr="2", color_r="74", color_g="74", color_b="255", color_a="255", pos_x="1.004106", pos_y="-0.6235294", pos_z="0", is_surrogate="False", keys="et_rad_horz,et_rad_norm,global_horz_irrad,direct_norm_irrad,diffuse_horz_irrad,global_horz_illum,direct_norm_illum,diffuse_horz_illum,zenith_luminance,total_sky_cvr,opaque_sky_cvr,dry_bulb_temp,dew_point_temp,relative_humidity,pressure,wind_dir,wind_speed,horz_visibility,ceiling_height,precipt_water,aerosol_depth,snow_depth,days_since_snow,solar_altitude,solar_azimuth,sun_is_up,absolute_humidity", values="0,0,0,0,0,999900,999900,999900,99990,0,0,4.4,3.6,95,101110,20,2.2,24.1,77777,0,0,0,88,-1.092806,1.136033,0,620.726"}, {hr="3", color_r="69", color_g="69", color_b="255", color_a="255", pos_x="1.005476", pos_y="-0.6188235", pos_z="0", is_surrogate="False", keys="et_rad_horz,et_rad_norm,global_horz_irrad,direct_norm_irrad,diffuse_horz_irrad,global_horz_illum,direct_norm_illum,diffuse_horz_illum,zenith_luminance,total_sky_cvr,opaque_sky_cvr,dry_bulb_temp,dew_point_temp,relative_humidity,pressure,wind_dir,wind_speed,horz_visibility,ceiling_height,precipt_water,aerosol_depth,snow_depth,days_since_snow,solar_altitude,solar_azimuth,sun_is_up,absolute_humidity", values="0,0,0,0,0,999900,999900,999900,99990,2,2,4.1,3.5,96,101060,10,2.3,24.1,77777,0,0,0,88,-0.8952814,1.392847,0,614.871"}, {hr="4", color_r="73", color_g="73", color_b="255", color_a="255", pos_x="1.006846", pos_y="-0.6517647", pos_z="0", is_surrogate="False", keys="et_rad_horz,et_rad_norm,global_horz_irrad,direct_norm_irrad,diffuse_horz_irrad,global_horz_illum,direct_norm_illum,diffuse_horz_illum,zenith_luminance,total_sky_cvr,opaque_sky_cvr,dry_bulb_temp,dew_point_temp,relative_humidity,pressure,wind_dir,wind_speed,horz_visibility,ceiling_height,precipt_water,aerosol_depth,snow_depth,days_since_snow,solar_altitude,solar_azimuth,sun_is_up,absolute_humidity", values="0,0,0,0,0,999900,999900,999900,99990,2,2,4.3,2.7,89,101090,27,2.4,24.1,77777,0,0,0,88,-0.6892139,1.57199,0,577.6714"}, {hr="5", color_r="86", color_g="86", color_b="255", color_a="255", pos_x="1.008215", pos_y="-0.6752941", pos_z="0", is_surrogate="False", keys="et_rad_horz,et_rad_norm,global_horz_irrad,direct_norm_irrad,diffuse_horz_irrad,global_horz_illum,direct_norm_illum,diffuse_horz_illum,zenith_luminance,total_sky_cvr,opaque_sky_cvr,dry_bulb_temp,dew_point_temp,relative_humidity,pressure,wind_dir,wind_speed,horz_visibility,ceiling_height,precipt_water,aerosol_depth,snow_depth,days_since_snow,solar_altitude,solar_azimuth,sun_is_up,absolute_humidity", values="0,0,0,0,0,999900,999900,999900,99990,2,2,5.1,2.7,84,101190,43,2.6,24.1,77777,0,0,0,88,-0.4829474,1.722077,0,574.8912"}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])
gradcolor2 = DoubleGradientColorization(
    DHours=oakland_epw,
    KeyA="dry_bulb_temp",
    DomainA="0 to 30",
    KeyB="relative_humidity",
    DomainB="0 to 100",
    AHighBHigh=RGB(255, 0, 0),
    AHighBLow=RGB(255, 255, 0),
    ALowBHigh=RGB(0, 0, 255),
    ALowBLow=RGB(255, 255, 255))  # -> DHours, Colors
dom² = Domain²(DomainU="0 to 12", DomainV="0.0 to 2.0")
pln = Plane(PlaneXY(0, 0, 0))

# ----
# Heatmap
heatmap = HeatmapSpatialization(DHours=gradcolor2.DHours, Location=pln, GraphDimensions=dom²)  # -> DHours, Positions, Regions, Mesh

heatmap_pts = Point(heatmap.Positions)
heatmap_recs = Rectangle(heatmap.Regions)
heatmap_mesh = Mesh(heatmap.Mesh)
heatmap_pts_2 = Point(heatmap_pts)
heatmap_recs_2 = Rectangle(heatmap_recs)
heatmap_mesh_2 = Mesh(heatmap_mesh)
