# Grasshopper definition spatialization - radial time-value.gh (Grasshopper 0.9.14)
# plug-ins: Dhour

oakland_epw = DataHour([{hr="0", color_r="96", color_g="96", color_b="255", color_a="255", pos_x="1.001366", pos_y="-0.637647", pos_z="0", is_surrogate="False", keys="et_rad_horz,et_rad_norm,global_horz_irrad,direct_norm_irrad,diffuse_horz_irrad,global_horz_illum,direct_norm_illum,diffuse_horz_illum,zenith_luminance,total_sky_cvr,opaque_sky_cvr,dry_bulb_temp,dew_point_temp,relative_humidity,pressure,wind_dir,wind_speed,horz_visibility,ceiling_height,precipt_water,aerosol_depth,snow_depth,days_since_snow,solar_altitude,solar_azimuth,sun_is_up,absolute_humidity", values="0,0,0,0,0,999900,999900,999900,99990,0,0,5.7,4.5,92,101430,40,1.9,24.1,77777,0,0,0,88,-1.309197,6.092528,0,655.0204"}, {hr="1", color_r="83", color_g="83", color_b="255", color_a="255", pos_x="1.002736", pos_y="-0.6329412", pos_z="0", is_surrogate="False", keys="et_rad_horz,et_rad_norm,global_horz_irrad,direct_norm_irrad,diffuse_horz_irrad,global_horz_illum,direct_norm_illum,diffuse_horz_illum,zenith_luminance,total_sky_cvr,opaque_sky_cvr,dry_bulb_temp,dew_point_temp,relative_humidity,pressure,wind_dir,wind_speed,horz_visibility,ceiling_height,precipt_water,aerosol_depth,snow_depth,days_since_snow,solar_altitude,solar_azimuth,sun_is_up,absolute_humidity", values="0,0,0,0,0,999900,999900,999900,99990,0,0,4.9,3.9,93,101230,30,2,24.1,77777,0,0,0,88,-1.257168,0.6658595,0,628.1306"}, {hr="2", color_r="74", color_g="74", color_b="255", color_a="255", pos_x="1.004106", pos_y="-0.6235294", pos_z="0", is_surrogate="False", keys="et_rad_horz,et_rad_norm,global_horz_irrad,direct_norm_irrad,diffuse_horz_irrad,global_horz_illum,direct_norm_illum,diffuse_horz_illum,zenith_luminance,total_sky_cvr,opaque_sky_cvr,dry_bulb_temp,dew_point_temp,relative_humidity,pressure,wind_dir,wind_speed,horz_visibility,ceiling_height,precipt_water,aerosol_depth,snow_depth,days_since_snow,solar_altitude,solar_azimuth,sun_is_up,absolute_humidity", values="0,0,0,0,0,999900,999900,999900,99990,0,0,4.4,3.6,95,101110,20,2.2,24.1,77777,0,0,0,88,-1.092806,1.136033,0,620.726"}, {hr="3", color_r="69", color_g="69", color_b="255", color_a="255", pos_x="1.005476", pos_y="-0.6188235", pos_z="0", is_surrogate="False", keys="et_rad_horz,et_rad_norm,global_horz_irrad,direct_norm_irrad,diffuse_horz_irrad,global_horz_illum,direct_norm_illum,diffuse_horz_illum,zenith_luminance,total_sky_cvr,opaque_sky_cvr,dry_bulb_temp,dew_point_temp,relative_humidity,pressure,wind_dir,wind_speed,horz_visibility,ceiling_height,precipt_water,aerosol_depth,snow_depth,days_since_snow,solar_altitude,solar_azimuth,sun_is_up,absolute_humidity", values="0,0,0,0,0,999900,999900,999900,99990,2,2,4.1,3.5,96,101060,10,2.3,24.1,77777,0,0,0,88,-0.8952814,1.392847,0,614.871"}, {hr="4", color_r="73", color_g="73", color_b="255", color_a="255", pos_x="1.006846", pos_y="-0.6517647", pos_z="0", is_surrogate="False", keys="et_rad_horz,et_rad_norm,global_horz_irrad,direct_norm_irrad,diffuse_horz_irrad,global_horz_illum,direct_norm_illum,diffuse_horz_illum,zenith_luminance,total_sky_cvr,opaque_sky_cvr,dry_bulb_temp,dew_point_temp,relative_humidity,pressure,wind_dir,wind_speed,horz_visibility,ceiling_height,precipt_water,aerosol_depth,snow_depth,days_since_snow,solar_altitude,solar_azimuth,sun_is_up,absolute_humidity", values="0,0,0,0,0,999900,999900,999900,99990,2,2,4.3,2.7,89,101090,27,2.4,24.1,77777,0,0,0,88,-0.6892139,1.57199,0,577.6714"}, {hr="5", color_r="86", color_g="86", color_b="255", color_a="255", pos_x="1.008215", pos_y="-0.6752941", pos_z="0", is_surrogate="False", keys="et_rad_horz,et_rad_norm,global_horz_irrad,direct_norm_irrad,diffuse_horz_irrad,global_horz_illum,direct_norm_illum,diffuse_horz_illum,zenith_luminance,total_sky_cvr,opaque_sky_cvr,dry_bulb_temp,dew_point_temp,relative_humidity,pressure,wind_dir,wind_speed,horz_visibility,ceiling_height,precipt_water,aerosol_depth,snow_depth,days_since_snow,solar_altitude,solar_azimuth,sun_is_up,absolute_humidity", values="0,0,0,0,0,999900,999900,999900,99990,2,2,5.1,2.7,84,101190,43,2.6,24.1,77777,0,0,0,88,-0.4829474,1.722077,0,574.8912"}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])
gradcolor2 = DoubleGradientColorization(
    DHours=oakland_epw,
    KeyA="dry_bulb_temp",
    DomainA="0 to 30",
    KeyB="relative_humidity",
    DomainB="0 to 100",
    AHighBHigh=RGB(255, 0, 0),
    AHighBLow=RGB(255, 255, 0),
    ALowBHigh=RGB(0, 0, 255),
    ALowBLow=RGB(255, 255, 255))  # -> DHours, Colors
colorized_hours = DataHour(gradcolor2.DHours)
colorized_hours_2 = DataHour(colorized_hours)

# ---- group: some setup
getval = GetValue(Dhour=colorized_hours_2, ValueKey="dry_bulb_temp")  # -> Value, Range
val_key = String("dry_bulb_temp")
val_key_2 = String(val_key)
val_range = Domain("2 to 22")
val_range_2 = Domain(val_range)

# ----
list = ValueList({"yearly", "monthly", "weekly", "daily", "monthly diurnal", "weekly diurnal"}, selected=[], ListIndex=4, UIMode=1)
stats = PeriodicStatistics(DHours=colorized_hours_2, Period=list)  # -> MeanHours, ModeHours, HighHours, UpperQuantileHours, MedianHours, LowerQuantileHours, LowHours, SumHours

# ---- group: x-axis is hour zero
pln = Plane(Plane(origin=(1, 0, 0), x=(0, 1, 0), y=(-1, 0, 0)))

pln_2 = Plane(Plane(origin=(-3, 0, 0), x=(0, 1, 0), y=(-1, 0, 0)))

# ----
base_plane = Plane(pln)
rad_domain = Domain("0.001 to 0.5")
sorthours = SortHours(DHours=colorized_hours_2, Key="dry_bulb_temp", AscendingDecending=False)
rad_domain_2 = Domain("0.001 to 0.5")
base_plane_2 = Plane(pln)
rad_domain_3 = Domain("0.001 to 0.5")
rad_domain_4 = Domain("0.001 to 0.5")
base_plane_3 = Plane(pln)
base_plane_4 = Plane(pln)
val_range_3 = Domain(val_range)
val_range_4 = Domain(val_range)
list_2 = ValueList({"year", "day", "none"}, selected=[], ListIndex=2, UIMode=1)
val_range_5 = Domain(val_range)
val_key_3 = String(val_key)
val_key_4 = String(val_key)
val_range_6 = Domain(val_range)
val_key_5 = String(val_key)
val_key_6 = String(val_key)

# ----
# Average Diurnal
# Radial Time-Value Graphs
radialtimeval = RadialTimeValueSpatialization(
    DHours=flatten(stats.MeanHours),
    Key=val_key_3,
    RadiusScale=val_range_3,
    Period="day",
    Location=base_plane_2,
    GraphRadii=rad_domain_2)  # -> DHours, Positions, Mesh
radialtimeval_2 = RadialTimeValueSpatialization(
    DHours=flatten(stats.UpperQuantileHours),
    Key=val_key_4,
    RadiusScale=val_range_4,
    Period="day",
    Location=base_plane_3,
    GraphRadii=rad_domain_3)  # -> DHours, Positions, Mesh
radialtimeval_3 = RadialTimeValueSpatialization(
    DHours=flatten(stats.LowerQuantileHours),
    Key=val_key_5,
    RadiusScale=val_range_5,
    Period="day",
    Location=base_plane_4,
    GraphRadii=rad_domain_4)  # -> DHours, Positions, Mesh

# ----
# Radial Time-Value Graphs
radialtimeval_4 = RadialTimeValueSpatialization(DHours=sorthours, Key=val_key_6, RadiusScale=val_range_6, Period=list_2, Location=pln_2, GraphRadii="0.5 to 2.5")  # -> DHours, Positions, Mesh

pt = Point(radialtimeval_4.Positions)
mesh = Mesh(radialtimeval_4.Mesh)

# ----
# Meanlines
pt_2 = Point(radialtimeval.Positions)
pline = PolyLine(Vertices=pt_2, Closed=True)
crv = Curve(flatten(pline))
lng = ListLength(List=crv)
series = Series(Start=0.5, Step=1, Count=lng)
tvecs = UnitX(Factor=series)
move = Move(Geometry=crv, Motion=tvecs)  # -> Geometry, Transform

# ----
# Quartile Mesh
getcolor = GetColor(DHour=radialtimeval_3.DHours)
getcolor_2 = GetColor(DHour=radialtimeval_2.DHours)
pt_3 = Point(radialtimeval_3.Positions)
pt_4 = Point(radialtimeval_2.Positions)
mesh_pointlists = MeshPointlists(a_pts=pt_4, b_pts=pt_3, a_cols=getcolor_2, b_cols=getcolor, close=Toggle(True))
mesh_2 = Mesh(flatten(mesh_pointlists))
move_2 = Move(Geometry=mesh_2, Motion=tvecs)  # -> Geometry, Transform
mesh_3 = Mesh(move_2.Geometry)

pline_2 = PolyLine(Vertices=pt, Closed=False)
branch = TreeBranch(Tree=radialtimeval.DHours, Path="{0}", MaintainPaths=True)
item = ListItem(List=mesh_3, Index=0, Wrap=False)
tri = Triangulate(Mesh=item)  # -> Mesh, Count
dhr = DataHour(branch)
mesh_4 = Mesh(tri.Mesh)

# ----
# Labels and Grid
cluster = Cluster_2(tvecs=tvecs, rad_domain="0.001 to 0.5", base_plane=pln, val_range=val_range)  # -> G, G_2, int_2
tag = TextTag(Location=cluster.G_2, Text=cluster.int_2)
geo = Geometry(cluster.G)

# ---- group: explode mesh to triangles
# note: this will break if the given mesh has any quad faces.
cluster_2 = Cluster(msh=mesh_4)

# ----
# Here we explode a mesh into triangles, and match each triangle with a color for plotting to SVG.  We have twice as many triangles as we do colors, so we have to duplicate our color data accordingly.
getcolor_3 = GetColor(DHour=dhr)
dup = DuplicateData(Data=getcolor_3, Number=2, Order=True)
crv_2 = Curve(cluster_2)

# ==== cluster MeshPointlists
b_pts = ClusterInput()
a_pts = ClusterInput()
a_cols = ClusterInput()
b_cols = ClusterInput()
close = ClusterInput()
close_2 = Boolean(close)
b_pts_2 = Point(b_pts)
# all given lists should be of equal length
a_pts_2 = Point(a_pts)
a_cols_2 = Colour(a_cols)
b_cols_2 = Colour(b_cols)
branch = TreeBranch(Tree=a_pts_2, Path="{0}", MaintainPaths=True)
lng = ListLength(List=branch)
i = Integer(expr("i+1", lng))
panel = Panel(lng)
i_2 = Integer(expr("i-1", lng))
i_3 = Integer(expr("i*2-1", lng))
panel_2 = Panel(i)
merge = Merge(Data1=a_cols_2, Data2=b_cols_2)
merge_2 = Merge(Data1=a_pts_2, Data2=b_pts_2)
series = Series(Start=panel, Step=1, Count=23)
series_2 = Series(Start=panel_2, Step=1, Count=23)
series_3 = Series(Start="0", Step=1, Count=23)
series_4 = Series(Start="1", Step=1, Count=23)
panel_3 = Panel(i_2)
panel_4 = Panel(lng)
panel_5 = Panel(i_3)
quad = MeshQuad(CornerA=panel_3, CornerB="0", CornerC=panel_4, CornerD=panel_5)
quad_2 = MeshQuad(CornerA=series_3, CornerB=series_4, CornerC=series_2, CornerD=series)
face = MeshFace(flatten([quad_2, quad]))
face_2 = MeshFace(flatten(quad_2))
filter = StreamFilter(Gate=close_2, Stream0=face_2, Stream1=face)
mesh = Mesh(Vertices=merge_2, Faces=filter, Colours=merge)
panel_6 = Panel(filter)
msh = ClusterOutput(mesh)

# ==== cluster Cluster
msh = ClusterInput()
mcomp = Decompose(Mesh=msh)  # -> Vertices, Faces, Colours, Normals
vertices = FaceVertices(Face=mcomp.Faces)  # -> CornerA, CornerB, CornerC, CornerD
item = ListItem(List=mcomp.Vertices, Index=vertices.CornerC, Wrap=False)  # -> graft(Element)
item_2 = ListItem(List=mcomp.Vertices, Index=vertices.CornerA, Wrap=False)  # -> graft(Element)
item_3 = ListItem(List=mcomp.Vertices, Index=vertices.CornerB, Wrap=False)  # -> graft(Element)
pt = Point(simplify([item_2, item, item_3]))
pline = PolyLine(Vertices=pt, Closed=True)  # -> flatten(Polyline)
tris = ClusterOutput(pline)

# ==== cluster Cluster_2
base_plane = ClusterInput()
rad_domain = ClusterInput()
val_range = ClusterInput()
tvecs = ClusterInput()
slider = Slider(5, range=0..10)
base_plane_2 = Plane(base_plane)
tvecs_2 = Vector(tvecs)
rad_domain_2 = Domain(rad_domain)
val_range_2 = Domain(val_range)
range = Range(Domain=rad_domain_2, Steps=slider)
range_2 = Range(Domain=val_range_2, Steps=slider)
int = Integer(range_2)
int_2 = ClusterOutput(int)
pt = PointOriented(BasePlane=base_plane_2, UComponent=range, VComponent=0, WComponent=0)
arc = Arc(Plane=base_plane_2, Radius=range, Angle="-PI/8 to PI/8")  # -> Arc, Length
arc_2 = Arc(Plane=base_plane_2, Radius=range, Angle="PI/8 to 15*PI/8")  # -> Arc, Length
panel = Panel("""0.01
0.03""")
dash = DashPattern(Curve=arc_2.Arc, Pattern=panel)  # -> flatten(Dashes), Gaps
crv = Curve(graft([arc.Arc, dash.Dashes]))
X = UnitX(Factor=-1)
move = Move(Geometry=crv, Motion=X)  # -> Geometry, Transform
move_2 = Move(Geometry=crv, Motion=tvecs_2)  # -> Geometry, Transform
G = ClusterOutput(move_2.Geometry)
move_3 = Move(Geometry=pt, Motion=X)  # -> Geometry, Transform
G_2 = ClusterOutput(move_3.Geometry)
