# Grasshopper definition spatialization - radial value-value.gh (Grasshopper 0.9.14)
# plug-ins: Dhour

oakland_epw = DataHour([{hr="0", color_r="96", color_g="96", color_b="255", color_a="255", pos_x="1.001366", pos_y="-0.637647", pos_z="0", is_surrogate="False", keys="et_rad_horz,et_rad_norm,global_horz_irrad,direct_norm_irrad,diffuse_horz_irrad,global_horz_illum,direct_norm_illum,diffuse_horz_illum,zenith_luminance,total_sky_cvr,opaque_sky_cvr,dry_bulb_temp,dew_point_temp,relative_humidity,pressure,wind_dir,wind_speed,horz_visibility,ceiling_height,precipt_water,aerosol_depth,snow_depth,days_since_snow,solar_altitude,solar_azimuth,sun_is_up,absolute_humidity", values="0,0,0,0,0,999900,999900,999900,99990,0,0,5.7,4.5,92,101430,40,1.9,24.1,77777,0,0,0,88,-1.309197,6.092528,0,655.0204"}, {hr="1", color_r="83", color_g="83", color_b="255", color_a="255", pos_x="1.002736", pos_y="-0.6329412", pos_z="0", is_surrogate="False", keys="et_rad_horz,et_rad_norm,global_horz_irrad,direct_norm_irrad,diffuse_horz_irrad,global_horz_illum,direct_norm_illum,diffuse_horz_illum,zenith_luminance,total_sky_cvr,opaque_sky_cvr,dry_bulb_temp,dew_point_temp,relative_humidity,pressure,wind_dir,wind_speed,horz_visibility,ceiling_height,precipt_water,aerosol_depth,snow_depth,days_since_snow,solar_altitude,solar_azimuth,sun_is_up,absolute_humidity", values="0,0,0,0,0,999900,999900,999900,99990,0,0,4.9,3.9,93,101230,30,2,24.1,77777,0,0,0,88,-1.257168,0.6658595,0,628.1306"}, {hr="2", color_r="74", color_g="74", color_b="255", color_a="255", pos_x="1.004106", pos_y="-0.6235294", pos_z="0", is_surrogate="False", keys="et_rad_horz,et_rad_norm,global_horz_irrad,direct_norm_irrad,diffuse_horz_irrad,global_horz_illum,direct_norm_illum,diffuse_horz_illum,zenith_luminance,total_sky_cvr,opaque_sky_cvr,dry_bulb_temp,dew_point_temp,relative_humidity,pressure,wind_dir,wind_speed,horz_visibility,ceiling_height,precipt_water,aerosol_depth,snow_depth,days_since_snow,solar_altitude,solar_azimuth,sun_is_up,absolute_humidity", values="0,0,0,0,0,999900,999900,999900,99990,0,0,4.4,3.6,95,101110,20,2.2,24.1,77777,0,0,0,88,-1.092806,1.136033,0,620.726"}, {hr="3", color_r="69", color_g="69", color_b="255", color_a="255", pos_x="1.005476", pos_y="-0.6188235", pos_z="0", is_surrogate="False", keys="et_rad_horz,et_rad_norm,global_horz_irrad,direct_norm_irrad,diffuse_horz_irrad,global_horz_illum,direct_norm_illum,diffuse_horz_illum,zenith_luminance,total_sky_cvr,opaque_sky_cvr,dry_bulb_temp,dew_point_temp,relative_humidity,pressure,wind_dir,wind_speed,horz_visibility,ceiling_height,precipt_water,aerosol_depth,snow_depth,days_since_snow,solar_altitude,solar_azimuth,sun_is_up,absolute_humidity", values="0,0,0,0,0,999900,999900,999900,99990,2,2,4.1,3.5,96,101060,10,2.3,24.1,77777,0,0,0,88,-0.8952814,1.392847,0,614.871"}, {hr="4", color_r="73", color_g="73", color_b="255", color_a="255", pos_x="1.006846", pos_y="-0.6517647", pos_z="0", is_surrogate="False", keys="et_rad_horz,et_rad_norm,global_horz_irrad,direct_norm_irrad,diffuse_horz_irrad,global_horz_illum,direct_norm_illum,diffuse_horz_illum,zenith_luminance,total_sky_cvr,opaque_sky_cvr,dry_bulb_temp,dew_point_temp,relative_humidity,pressure,wind_dir,wind_speed,horz_visibility,ceiling_height,precipt_water,aerosol_depth,snow_depth,days_since_snow,solar_altitude,solar_azimuth,sun_is_up,absolute_humidity", values="0,0,0,0,0,999900,999900,999900,99990,2,2,4.3,2.7,89,101090,27,2.4,24.1,77777,0,0,0,88,-0.6892139,1.57199,0,577.6714"}, {hr="5", color_r="86", color_g="86", color_b="255", color_a="255", pos_x="1.008215", pos_y="-0.6752941", pos_z="0", is_surrogate="False", keys="et_rad_horz,et_rad_norm,global_horz_irrad,direct_norm_irrad,diffuse_horz_irrad,global_horz_illum,direct_norm_illum,diffuse_horz_illum,zenith_luminance,total_sky_cvr,opaque_sky_cvr,dry_bulb_temp,dew_point_temp,relative_humidity,pressure,wind_dir,wind_speed,horz_visibility,ceiling_height,precipt_water,aerosol_depth,snow_depth,days_since_snow,solar_altitude,solar_azimuth,sun_is_up,absolute_humidity", values="0,0,0,0,0,999900,999900,999900,99990,2,2,5.1,2.7,84,101190,43,2.6,24.1,77777,0,0,0,88,-0.4829474,1.722077,0,574.8912"}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])
gradcolor2 = DoubleGradientColorization(
    DHours=oakland_epw,
    KeyA="dry_bulb_temp",
    DomainA="0 to 30",
    KeyB="relative_humidity",
    DomainB="0 to 100",
    AHighBHigh=RGB(255, 0, 0),
    AHighBLow=RGB(255, 255, 0),
    ALowBHigh=RGB(0, 0, 255),
    ALowBLow=RGB(255, 255, 255))  # -> DHours, Colors
colorized_hours = DataHour(gradcolor2.DHours)
colorized_hours_2 = DataHour(colorized_hours)

# ---- group: radial graphs can work with masked hours
# Dec 21 to Jun 21
panel = Panel("June 21 to Dec 20")
panel_2 = Panel("8pm to 8am")
panel_3 = Panel("8am to 8pm")
maskhours = MaskHours(DHours=colorized_hours_2, Hourmask=panel)

# ----
hours_for_radial_plot = DataHour(colorized_hours_2)

# ---- group: x-axis is north
base_plane = Plane(Plane(origin=(6, 6, 0), x=(0, 1, 0), y=(-1, 0, 0)))

# ----
dom = Domain(DomainStart=Slider(9, range=2..20), DomainEnd=Slider(30, range=2..30))

# ---- group: cull outlying hours to eliminate zero wind speed
toggle = BooleanToggle(True)

# ----
dom² = Domain²(DomainU="0.1 to 10", DomainV="0 to 360")

# ----
# Radial Value-Value Graphs
radialvalval = RadialValueValueSpatialization(
    DHours=hours_for_radial_plot,
    RadiusKey="wind_speed",
    AngleKey="wind_dir",
    RadiusScale="0.1 to 10",
    AngleScale="0 to 360",
    Location=base_plane,
    GraphRadii="0.5 to 5",
    Subdivisions=dom)  # -> DHours, Positions, Regions

hourfreq2 = HourFrequencyTwo(Dhrs=hours_for_radial_plot, Key_U="wind_speed", Key_V="wind_dir", Ival2=dom², Divs=dom, Cul=toggle)  # -> Frequencies, Subintervals, DHours
freqs_from_hourfreq2 = Integer(hourfreq2.Frequencies)
pt = Point(radialvalval.Positions)
crv = Curve(radialvalval.Regions)
pcen = PolygonCenter(Polyline=crv)  # -> CenterV, CenterE
region_ctr_pts = Point(pcen.CenterE)

# ---- group: isolates hours with zero wind speed for central graph
list = ValueList(
    {"is equal to": "==", "is not equal to": "!=", "is greater than": "> ", "is greater than or equal to": ">=", "is less than": "<", "is less than or equal to": "<="}, selected=[],
    ListIndex=0,
    UIMode=1)
condfilter = HourConditionalFilter(DHours=hours_for_radial_plot, Key="wind_speed", Operator=list, Value="0.0")

# ----
# Pie Charts
max_slices_per_pie = Slider(5, range=2..20)
hourfreq = HourFrequency(DHours=hourfreq2.DHours, Key="dry_bulb_temp", Interval="0 to 30", Subdivisions=max_slices_per_pie)  # -> Frequencies, Subintervals, DHours
getcolor = GetColor(DHour=hourfreq.DHours)
lng = ListLength(List=condfilter)
avr = Average(Input=getcolor)
count_of_hours_with_no_wind = String(lng)
freqs_from_hourfreq2_2 = Integer(flatten(freqs_from_hourfreq2))
path_mapper = PathMapper(hourfreq.Frequencies, source="{a;b;c}", target="{a;b}(c)")
path_mapper_2 = PathMapper(avr, source="{a;b;c}", target="{a;b}(c)")
bnd = Bounds(Numbers=flatten([freqs_from_hourfreq2_2, count_of_hours_with_no_wind]))
region_ctr_pts_2 = Point(region_ctr_pts)
base_plane_2 = Plane(base_plane)
pie_chart_radii = Panel("0.04 to 0.5")
ma = MassAddition(Input=path_mapper)  # -> Result, PartialResults
orient_those_planes = OrientThosePlanes(O=region_ctr_pts_2, A=region_ctr_pts_2, B=base_plane_2)
remap = RemapNumbers(Value=ma.Result, Source=bnd, Target=pie_chart_radii)
remap_2 = RemapNumbers(Value=count_of_hours_with_no_wind, Source=bnd, Target=pie_chart_radii)
dom_2 = Domain(DomainStart=".01", DomainEnd=remap)
base_plane_3 = Plane(base_plane)

# ---- group: isolates hours with zero wind speed for central graph (continued)
hourfreq_2 = HourFrequency(DHours=condfilter, Key="dry_bulb_temp", Interval="0 to 30", Subdivisions=max_slices_per_pie)  # -> flatten(Frequencies), Subintervals, DHours
getcolor_2 = GetColor(DHour=hourfreq_2.DHours)
avr_2 = Average(Input=getcolor_2)  # -> flatten(ArithmeticMean)

# ----
# Pie Graphs
piegraph = PieGraph(Values=path_mapper, Colors=path_mapper_2, Location=orient_those_planes, GraphRadii=dom_2)  # -> Regions, Mesh, Colors
piegraph_2 = PieGraph(Values=hourfreq_2.Frequencies, Colors=avr_2, Location=base_plane_3, GraphRadii=remap_2)  # -> Regions, Mesh, Colors

mesh = Mesh(piegraph.Mesh)
crv_2 = Curve(piegraph.Regions)
mesh_2 = Mesh(piegraph_2.Mesh)
crv_3 = Curve(piegraph_2.Regions)

# ==== cluster OrientThosePlanes
Z = UnitZ(Factor=1)
A = ClusterInput()
B = ClusterInput()
vec2pt = Vector2Pt(PointA=A, PointB=B, Unitize=False)  # -> Vector, Length
xprod = CrossProduct(VectorA=vec2pt.Vector, VectorB=Z, Unitize=False)  # -> Vector, Length
O = ClusterInput()
pl = Plane(Origin=O, XAxis=vec2pt.Vector, YAxis=xprod.Vector)
pl_2 = ClusterOutput(pl)
