# Grasshopper definition spatialization - solargraph.gh (Grasshopper 0.9.14)
# plug-ins: Dhour

oakland_epw = DataHour([{hr="0", color_r="96", color_g="96", color_b="255", color_a="255", pos_x="1.001366", pos_y="-0.637647", pos_z="0", is_surrogate="False", keys="et_rad_horz,et_rad_norm,global_horz_irrad,direct_norm_irrad,diffuse_horz_irrad,global_horz_illum,direct_norm_illum,diffuse_horz_illum,zenith_luminance,total_sky_cvr,opaque_sky_cvr,dry_bulb_temp,dew_point_temp,relative_humidity,pressure,wind_dir,wind_speed,horz_visibility,ceiling_height,precipt_water,aerosol_depth,snow_depth,days_since_snow,solar_altitude,solar_azimuth,sun_is_up,absolute_humidity", values="0,0,0,0,0,999900,999900,999900,99990,0,0,5.7,4.5,92,101430,40,1.9,24.1,77777,0,0,0,88,-1.309197,6.092528,0,655.0204"}, {hr="1", color_r="83", color_g="83", color_b="255", color_a="255", pos_x="1.002736", pos_y="-0.6329412", pos_z="0", is_surrogate="False", keys="et_rad_horz,et_rad_norm,global_horz_irrad,direct_norm_irrad,diffuse_horz_irrad,global_horz_illum,direct_norm_illum,diffuse_horz_illum,zenith_luminance,total_sky_cvr,opaque_sky_cvr,dry_bulb_temp,dew_point_temp,relative_humidity,pressure,wind_dir,wind_speed,horz_visibility,ceiling_height,precipt_water,aerosol_depth,snow_depth,days_since_snow,solar_altitude,solar_azimuth,sun_is_up,absolute_humidity", values="0,0,0,0,0,999900,999900,999900,99990,0,0,4.9,3.9,93,101230,30,2,24.1,77777,0,0,0,88,-1.257168,0.6658595,0,628.1306"}, {hr="2", color_r="74", color_g="74", color_b="255", color_a="255", pos_x="1.004106", pos_y="-0.6235294", pos_z="0", is_surrogate="False", keys="et_rad_horz,et_rad_norm,global_horz_irrad,direct_norm_irrad,diffuse_horz_irrad,global_horz_illum,direct_norm_illum,diffuse_horz_illum,zenith_luminance,total_sky_cvr,opaque_sky_cvr,dry_bulb_temp,dew_point_temp,relative_humidity,pressure,wind_dir,wind_speed,horz_visibility,ceiling_height,precipt_water,aerosol_depth,snow_depth,days_since_snow,solar_altitude,solar_azimuth,sun_is_up,absolute_humidity", values="0,0,0,0,0,999900,999900,999900,99990,0,0,4.4,3.6,95,101110,20,2.2,24.1,77777,0,0,0,88,-1.092806,1.136033,0,620.726"}, {hr="3", color_r="69", color_g="69", color_b="255", color_a="255", pos_x="1.005476", pos_y="-0.6188235", pos_z="0", is_surrogate="False", keys="et_rad_horz,et_rad_norm,global_horz_irrad,direct_norm_irrad,diffuse_horz_irrad,global_horz_illum,direct_norm_illum,diffuse_horz_illum,zenith_luminance,total_sky_cvr,opaque_sky_cvr,dry_bulb_temp,dew_point_temp,relative_humidity,pressure,wind_dir,wind_speed,horz_visibility,ceiling_height,precipt_water,aerosol_depth,snow_depth,days_since_snow,solar_altitude,solar_azimuth,sun_is_up,absolute_humidity", values="0,0,0,0,0,999900,999900,999900,99990,2,2,4.1,3.5,96,101060,10,2.3,24.1,77777,0,0,0,88,-0.8952814,1.392847,0,614.871"}, {hr="4", color_r="73", color_g="73", color_b="255", color_a="255", pos_x="1.006846", pos_y="-0.6517647", pos_z="0", is_surrogate="False", keys="et_rad_horz,et_rad_norm,global_horz_irrad,direct_norm_irrad,diffuse_horz_irrad,global_horz_illum,direct_norm_illum,diffuse_horz_illum,zenith_luminance,total_sky_cvr,opaque_sky_cvr,dry_bulb_temp,dew_point_temp,relative_humidity,pressure,wind_dir,wind_speed,horz_visibility,ceiling_height,precipt_water,aerosol_depth,snow_depth,days_since_snow,solar_altitude,solar_azimuth,sun_is_up,absolute_humidity", values="0,0,0,0,0,999900,999900,999900,99990,2,2,4.3,2.7,89,101090,27,2.4,24.1,77777,0,0,0,88,-0.6892139,1.57199,0,577.6714"}, {hr="5", color_r="86", color_g="86", color_b="255", color_a="255", pos_x="1.008215", pos_y="-0.6752941", pos_z="0", is_surrogate="False", keys="et_rad_horz,et_rad_norm,global_horz_irrad,direct_norm_irrad,diffuse_horz_irrad,global_horz_illum,direct_norm_illum,diffuse_horz_illum,zenith_luminance,total_sky_cvr,opaque_sky_cvr,dry_bulb_temp,dew_point_temp,relative_humidity,pressure,wind_dir,wind_speed,horz_visibility,ceiling_height,precipt_water,aerosol_depth,snow_depth,days_since_snow,solar_altitude,solar_azimuth,sun_is_up,absolute_humidity", values="0,0,0,0,0,999900,999900,999900,99990,2,2,5.1,2.7,84,101190,43,2.6,24.1,77777,0,0,0,88,-0.4829474,1.722077,0,574.8912"}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])
gradcolor2 = DoubleGradientColorization(
    DHours=oakland_epw,
    KeyA="dry_bulb_temp",
    DomainA="0 to 30",
    KeyB="relative_humidity",
    DomainB="0 to 100",
    AHighBHigh=RGB(255, 0, 0),
    AHighBLow=RGB(255, 255, 0),
    ALowBHigh=RGB(0, 0, 255),
    ALowBLow=RGB(255, 255, 255))  # -> DHours, Colors
colorized_hours = DataHour(gradcolor2.DHours)
# Radial Value-Value Graphs
# Radial Time-Value Graphs
panel = Panel("Dec 21 to Jun 21")
baseplane = Plane(PlaneXY(0, -3, 0))
maskhours = MaskHours(DHours=colorized_hours, Hourmask="June 21 to Dec 20")
list = ValueList({"Stereographic": "Stereo", "Orthographic": "Ortho"}, selected=[], ListIndex=0, UIMode=1)
maskhours_2 = MaskHours(DHours=colorized_hours, Hourmask=panel)
radius = Number(Slider(2, range=0..10))
baseplane_2 = Plane(PlaneXY(0, 0, 0))
maskhours_3 = MaskHours(DHours=colorized_hours, Hourmask="June 21 to Dec 20")
list_2 = ValueList({"Stereographic": "Stereo", "Orthographic": "Ortho"}, selected=[], ListIndex=1, UIMode=1)
maskhours_4 = MaskHours(DHours=colorized_hours, Hourmask="Dec 21 to Jun 21")
baseplane_3 = Plane(baseplane_2)
radius_2 = Number(radius)
radius_3 = Number(radius)

# ----
# Orthographic
# Solar Position
panel_2 = Panel("-4 to 0")
baseplane_4 = Plane(baseplane_2)
dom² = Domain²(DomainU=panel_2, DomainV="0 to 2")
dom²_2 = Domain²(DomainU="0 to 4", DomainV="0 to 2")
baseplane_5 = Plane(baseplane_2)
sunpos = SolarPositionSpatialization(
    DHours=maskhours_3,
    Location=baseplane_4,
    GraphDimensions=dom²,
    GraphRadius=3,
    PlotType=list_2,
    SolarAltitudeKey="solar_altitude",
    SolarAzimuthKey="solar_azimuth",
    CullNighttime=True)  # -> DHours, Positions, Lines, Colors, Mesh, TrimBoundary
sunpos_2 = SolarPositionSpatialization(
    DHours=maskhours_4,
    Location=baseplane_5,
    GraphDimensions=dom²_2,
    GraphRadius=3,
    PlotType=list_2,
    SolarAltitudeKey="solar_altitude",
    SolarAzimuthKey="solar_azimuth",
    CullNighttime=True)  # -> DHours, Positions, Lines, Colors, Mesh, TrimBoundary

X = UnitX(Factor=expr("F*1.1", radius_3))
X_2 = UnitX(Factor=expr("-F*1.1", radius_2))
move = Move(Geometry=baseplane, Motion=X)  # -> Geometry, Transform
move_2 = Move(Geometry=baseplane, Motion=X_2)  # -> Geometry, Transform
radius_4 = Number(radius)
radius_5 = Number(radius)

# ----
# Stereographic
# Solar Position
sunpos_3 = SolarPositionSpatialization(
    DHours=maskhours,
    Location=move_2.Geometry,
    GraphRadius=radius_5,
    PlotType=list,
    SolarAltitudeKey="solar_altitude",
    SolarAzimuthKey="solar_azimuth",
    CullNighttime=True)  # -> DHours, Positions, Lines, Colors, Mesh, TrimBoundary
sunpos_4 = SolarPositionSpatialization(
    DHours=maskhours_2,
    Location=move.Geometry,
    GraphRadius=radius_4,
    PlotType=list,
    SolarAltitudeKey="solar_altitude",
    SolarAzimuthKey="solar_azimuth",
    CullNighttime=True)  # -> DHours, Positions, Lines, Colors, Mesh, TrimBoundary

mesh = Mesh(sunpos_2.Mesh)
mesh_2 = Mesh(sunpos_4.Mesh)
mesh_3 = Mesh(sunpos.Mesh)
mesh_4 = Mesh(sunpos_3.Mesh)
trim_lines_w_colors = TrimLinesWColors(clrs=sunpos_3.Colors, lns=sunpos_3.Lines, bnd=sunpos_3.TrimBoundary)  # -> clrs_4, lns_3
trim_lines_w_colors_2 = TrimLinesWColors(clrs=sunpos.Colors, lns=sunpos.Lines, bnd=sunpos.TrimBoundary)  # -> clrs_4, lns_3
trim_lines_w_colors_3 = TrimLinesWColors(clrs=sunpos_4.Colors, lns=sunpos_4.Lines, bnd=sunpos_4.TrimBoundary)  # -> clrs_4, lns_3
trim_lines_w_colors_4 = TrimLinesWColors(clrs=sunpos_2.Colors, lns=sunpos_2.Lines, bnd=sunpos_2.TrimBoundary)  # -> clrs_4, lns_3
crv = Curve([trim_lines_w_colors.lns_3, trim_lines_w_colors_3.lns_3])
crv_2 = Curve([trim_lines_w_colors_2.lns_3, trim_lines_w_colors_4.lns_3])
col = Colour([trim_lines_w_colors.clrs_4, trim_lines_w_colors_3.clrs_4])
col_2 = Colour([trim_lines_w_colors_2.clrs_4, trim_lines_w_colors_4.clrs_4])

# ----
# Pie Graphs
click_to_bake = Button()
color_to_bake = Colour(col)
geom_to_bake = Geometry(crv)
color_bake = COLORBAKE(geo=geom_to_bake, col=color_to_bake, bool=click_to_bake)  # -> geo_3, col_3
preview = CustomPreview(Geometry=color_bake.geo_3, Shader=color_bake.col_3)

click_to_bake_2 = Button()
color_to_bake_2 = Colour(col_2)
geom_to_bake_2 = Geometry(crv_2)
color_bake_2 = COLORBAKE(geo=geom_to_bake_2, col=color_to_bake_2, bool=click_to_bake_2)  # -> geo_3, col_3
preview_2 = CustomPreview(Geometry=color_bake_2.geo_3, Shader=color_bake_2.col_3)

# ==== cluster COLORBAKE
geo = ClusterInput()
col = ClusterInput()
geo_2 = Geometry(geo)
col_2 = Colour(col)
argb = SplitARGB(Colour=col_2)  # -> Alpha, Red, Green, Blue
frgb = ColourRGBF(Alpha=1, Red=argb.Red, Green=argb.Green, Blue=argb.Blue)
material = CreateMaterial(Diffuse=frgb, Specular=RGB(255, 255, 255), Emission=RGB(0, 0, 0), Transparency=expr("1-T", argb.Alpha), Shine=0)
bool = ClusterInput()
bool_2 = Boolean(bool)
c_script = CSharpScript(objs=geo_2, colors=col_2, materials=material, activate=bool_2, groupListTgthr=Toggle(True))  # -> out, A; inputs objs: list, names: list of String, layers: list of String, colors: list of Color, pWidths: list of Double, wiresEach: list of Int32, materials: list, activate: Boolean, groupListTgthr: Boolean
# ---------- c_script: C# ----------
    //Inserts geometry into the Rhino document, with custom attributes
    //Written by Giulio Piacentino
    //Version written 2011 10 18 - for Grasshopper 0.8.52

    if (activate)
    {
      int groupIndex = -1;
      if(groupListTgthr)
        groupIndex = doc.Groups.Add();

      for(int i = 0; i < objs.Count; i++)
      {
        object obj = objs[i];
        if(obj == null)
        {
          Print("No object to bake");
          return;
        }

        //Make new attribute to set name
        Rhino.DocObjects.ObjectAttributes att = new Rhino.DocObjects.ObjectAttributes();

        string name = names.Count > 0 ? names[i % names.Count] : null;
        //Set object name
        if(!string.IsNullOrEmpty(name))
        {
          att.Name = name;
        }

        Color color = colors.Count > 0 ? colors[i % colors.Count] : new Color();
        //Set color
        if(!color.IsEmpty)
        {
          att.ColorSource = Rhino.DocObjects.ObjectColorSource.ColorFromObject; //Make the color type "by object"
          att.ObjectColor = color;

          att.PlotColorSource = Rhino.DocObjects.ObjectPlotColorSource.PlotColorFromObject; //Make the plot color type "by object"
          att.PlotColor = color;
        }

        string layer = layers.Count > 0 ? layers[i % layers.Count] : null;
        //Set layer
        if(!string.IsNullOrEmpty(layer) && Rhino.DocObjects.Layer.IsValidName(layer))
        {
          //Get the current layer index
          Rhino.DocObjects.Tables.LayerTable layerTable = doc.Layers;
          int layerIndex = layerTable.Find(layer, true);

          if(layerIndex < 0) //This layer does not exist, we add it
          {
            Rhino.DocObjects.Layer onlayer = new Rhino.DocObjects.Layer(); //Make a new layer
            onlayer.Name = layer;

            layerIndex = layerTable.Add(onlayer); //Add the layer to the layer table
            if (layerIndex > -1) //We manged to add layer!
            {
              att.LayerIndex = layerIndex;
              Print("Added new layer to the document at position " + layerIndex + " named " + layer + ". ");
            } else
              Print("Layer did not add. Try cleaning up your layers."); //This never happened to me.
          }
          else
            att.LayerIndex = layerIndex; //We simply add to the existing layer
        }


        double pWidth = pWidths.Count > 0 ? pWidths[i % pWidths.Count] : 0;
        //Set plotweight
        if(pWidth > 0)
        {
          att.PlotWeightSource = Rhino.DocObjects.ObjectPlotWeightSource.PlotWeightFromObject;
          att.PlotWeight = pWidth;
        }


        object material = materials.Count > 0 ? materials[i % materials.Count] : null;
        //Set material
        bool materialByName = !string.IsNullOrEmpty(material as string);
        Rhino.Display.DisplayMaterial inMaterial = material as Rhino.Display.DisplayMaterial;
        if(material is Color)
        {
          inMaterial = new Rhino.Display.DisplayMaterial((Color) material);
        }
        if(material != null && inMaterial == null && !materialByName)
        {
          if(!(material is string))
          {
            try //We also resort to try with IConvertible
            {
              inMaterial = (Rhino.Display.DisplayMaterial) Convert.ChangeType(material, typeof(Rhino.Display.DisplayMaterial));
            }
            catch(InvalidCastException)
            {
            }
          }
        }
        if(inMaterial != null || materialByName)
        {
          string matName;

          if(!materialByName)
          {
            matName = string.Format("A:{0}-D:{1}-E:{2}-S:{3},{4}-T:{5}",
              Format(inMaterial.Ambient),
              Format(inMaterial.Diffuse),
              Format(inMaterial.Emission),
              Format(inMaterial.Specular),
              inMaterial.Shine.ToString(),
              inMaterial.Transparency.ToString()
              );
          }
          else
          {
            matName = (string) material;
          }

          int materialIndex = doc.Materials.Find(matName, true);
          if(materialIndex < 0 && !materialByName) //Material does not exist and we have its specs
          {
            materialIndex = doc.Materials.Add(); //Let's add it
            if(materialIndex > -1)
            {
              Print("Added new material at position " + materialIndex + " named \"" + matName + "\". ");
              Rhino.DocObjects.Material m = doc.Materials[materialIndex];
              m.Name = matName;
              m.AmbientColor = inMaterial.Ambient;
              m.DiffuseColor = inMaterial.Diffuse;
              m.EmissionColor = inMaterial.Emission;
              //m.ReflectionColor = no equivalent
              m.SpecularColor = inMaterial.Specular;
              m.Shine = inMaterial.Shine;
              m.Transparency = inMaterial.Transparency;
              //m.TransparentColor = no equivalent
              m.CommitChanges();

              att.MaterialSource = Rhino.DocObjects.ObjectMaterialSource.MaterialFromObject;
              att.MaterialIndex = materialIndex;
            }
            else
              Print("Material did not add. Try cleaning up your materials."); //This never happened to me.
          }
          else if(materialIndex < 0 && materialByName) //Material does not exist and we do not have its specs. We do nothing
          {
            Print("Warning: material name not found. I cannot set the source to this material name. Add a material with name: " + matName);
          }
          else
          {
            //If this material exists, we do not replace it!
            att.MaterialSource = Rhino.DocObjects.ObjectMaterialSource.MaterialFromObject;
            att.MaterialIndex = materialIndex;
          }
        }


        int wires = wiresEach.Count > 0 ? wiresEach[i % wiresEach.Count] : 0;
        //Set wire density
        if(wires == -1 || wires > 0)
        {
          att.WireDensity = wires;
        }

        Bake(obj, att, groupIndex);
      }
    }
    else
    {
      Print("Inactive");
    }
# ---------- c_script: C# additional code ----------
  void Bake(object obj, Rhino.DocObjects.ObjectAttributes att, int groupIndex)
  {
    if(obj == null)
      return;

    Guid id;

    //Bake to the right type of object
    if(obj is GeometryBase)
    {
      GeometryBase geomObj = obj as GeometryBase;

      switch(geomObj.ObjectType)
      {
        case Rhino.DocObjects.ObjectType.Brep:
          id = doc.Objects.AddBrep(obj as Brep, att);
          break;
        case Rhino.DocObjects.ObjectType.Curve:
          id = doc.Objects.AddCurve(obj as Curve, att);
          break;
        case Rhino.DocObjects.ObjectType.Point:
          id = doc.Objects.AddPoint((obj as Rhino.Geometry.Point).Location, att);
          break;
        case Rhino.DocObjects.ObjectType.Surface:
          id = doc.Objects.AddSurface(obj as Surface, att);
          break;
        case Rhino.DocObjects.ObjectType.Mesh:
          id = doc.Objects.AddMesh(obj as Mesh, att);
          break;
        case (Rhino.DocObjects.ObjectType) 1073741824://Rhino.DocObjects.ObjectType.Extrusion:
          id = (Guid) typeof(Rhino.DocObjects.Tables.ObjectTable).InvokeMember("AddExtrusion", BindingFlags.Instance | BindingFlags.InvokeMethod, null, doc.Objects, new object[]{obj, att});
          break;
        case Rhino.DocObjects.ObjectType.PointSet:
          id = doc.Objects.AddPointCloud(obj as Rhino.Geometry.PointCloud, att); //This is a speculative entry
          break;
        default:
          Print("The script does not know how to handle this type of geometry: " + obj.GetType().FullName);
          return;
      }
    }
    else
    {
      Type objectType = obj.GetType();

      if(objectType == typeof(Arc))
      {
        id = doc.Objects.AddArc((Arc) obj, att);
      }
      else if(objectType == typeof(Box))
      {
        id = doc.Objects.AddBrep(((Box) obj).ToBrep(), att);
      }
      else if(objectType == typeof(Circle))
      {
        id = doc.Objects.AddCircle((Circle) obj, att);
      }
      else if(objectType == typeof(Ellipse))
      {
        id = doc.Objects.AddEllipse((Ellipse) obj, att);
      }
      else if(objectType == typeof(Polyline))
      {
        id = doc.Objects.AddPolyline((Polyline) obj, att);
      }
      else if(objectType == typeof(Sphere))
      {
        id = doc.Objects.AddSphere((Sphere) obj, att);
      }
      else if(objectType == typeof(Point3d))
      {
        id = doc.Objects.AddPoint((Point3d) obj, att);
      }
      else if(objectType == typeof(Line))
      {
        id = doc.Objects.AddLine((Line) obj, att);
      }
      else if(objectType == typeof(Vector3d))
      {
        Print("Impossible to bake vectors");
        return;
      }
      else if(obj is IEnumerable)
      {
        int newGroupIndex;
        if(groupIndex == -1)
          newGroupIndex = doc.Groups.Add();
        else
          newGroupIndex = groupIndex;
        foreach(object o in obj as IEnumerable)
        {
          Bake(o, att, newGroupIndex);
        }
        return;
      }
      else
      {
        Print("Unhandled type: " + objectType.FullName);
        return;
      }
    }

    if(groupIndex != -1)
    {
      doc.Groups.AddToGroup(groupIndex, id);
      Print("Added " + obj.GetType().Name + " to group number " + groupIndex);
    }
    else
      Print("Added " + obj.GetType().Name);
  }

  static string Format(Color c)
  {
    return (new System.Text.StringBuilder("A")).Append(c.A.ToString()).Append("R").Append(c.R.ToString()).Append("G")
      .Append(c.G.ToString()).Append("B").Append(c.B.ToString()).ToString();
  }
# ---------- end c_script ----------
geo_3 = ClusterOutput(geo_2)
col_3 = ClusterOutput(col_2)

# ==== cluster TrimLinesWColors
lns = ClusterInput()
bnd = ClusterInput()
clrs = ClusterInput()
trim = TrimWithRegion(Curve=lns, Region=bnd)  # -> Inside, Outside
clrs_2 = Colour(graft(clrs))
data = Data([clrs_2, trim.Inside])
prune = PruneTree(Data=data, Minimum=2, Maximum=2)  # -> simplify(Tree)
path_mapper = PathMapper(prune, source="{a}(i)", target="{i}(a)")
bang = ExplodeTree(Data=path_mapper)  # -> Branch0, Branch1
clean = CleanTree(Data=bang.Branch1, CleanInvalid=True, CleanEmpty=False)
clean_2 = CleanTree(Data=bang.Branch0, CleanInvalid=True, CleanEmpty=False)
lns_2 = Curve(clean)
clrs_3 = Colour(clean_2)
lns_3 = ClusterOutput(lns_2)
clrs_4 = ClusterOutput(clrs_3)
