# Grasshopper definition spatialization - stacked time-value.gh (Grasshopper 0.9.14)
# plug-ins: Python Interpreter, Dhour

# ----
# This component has internalized the hours from an E+ output file.  No need to use the E+ parser.
# This python component calculates thermal gains and losses per zone area for people, lights, equipment, ventilation, envelope, and solar, and produces a new set of dhours containing these keys.
# 
# The results have been internalized, and the component disabled.  Just in case.
e_zone_1 = DataHour([{hr="0", color_r="0", color_g="0", color_b="0", color_a="255", pos_x="0", pos_y="0", pos_z="0", is_surrogate="False", keys="zone people number of occupants [],zone people total heat gain [j],zone lights total heat gain [j],zone electric equipment total heat gain [j],zone window heat gain[w],zone window heat loss[w],zone transmitted solar energy[j],zone mean radiant temperature [c],zone mean air temperature [c],zone operative temperature [c],zone air balance surface convection rate [w],zone infiltration total heat loss [j],zone infiltration total heat gain [j],zone infiltration air change rate [ach],zone ventilation total heat loss [j],zone ventilation total heat gain [j],zone ventilation air change rate [ach],zone ventilation fan electric consumption [j],zonesys sensible heating energy [j],zonesys sensible cooling energy [j],lights : lights electric power [w],equip : electric equipment electric power [w],face_1_window_1 : window transmitted beam solar [w],face_1_window_1 : window heat gain [w],face_1_window_1 : window heat loss [w],face_1_window_2 : window transmitted beam solar [w],face_1_window_2 : window heat gain [w],face_1_window_2 : window heat loss [w],face_4_window_1 : window transmitted beam solar [w],face_4_window_1 : window heat gain [w],face_4_window_1 : window heat loss [w]", values="0,0,13378.04,80268.23,0,149.9314,0,16.61388,15.74007,16.17697,333.6075,1120048,0,0.5156263,0,0,0,0,0,0,3.716122,22.29673,0,0,51.0757,0,0,48.91428,0,0,49.94139"}, {hr="1", color_r="0", color_g="0", color_b="0", color_a="255", pos_x="0", pos_y="0", pos_z="0", is_surrogate="False", keys="zone people number of occupants [],zone people total heat gain [j],zone lights total heat gain [j],zone electric equipment total heat gain [j],zone window heat gain[w],zone window heat loss[w],zone transmitted solar energy[j],zone mean radiant temperature [c],zone mean air temperature [c],zone operative temperature [c],zone air balance surface convection rate [w],zone infiltration total heat loss [j],zone infiltration total heat gain [j],zone infiltration air change rate [ach],zone ventilation total heat loss [j],zone ventilation total heat gain [j],zone ventilation air change rate [ach],zone ventilation fan electric consumption [j],zonesys sensible heating energy [j],zonesys sensible cooling energy [j],lights : lights electric power [w],equip : electric equipment electric power [w],face_1_window_1 : window transmitted beam solar [w],face_1_window_1 : window heat gain [w],face_1_window_1 : window heat loss [w],face_1_window_2 : window transmitted beam solar [w],face_1_window_2 : window heat gain [w],face_1_window_2 : window heat loss [w],face_4_window_1 : window transmitted beam solar [w],face_4_window_1 : window heat gain [w],face_4_window_1 : window heat loss [w]", values="0,0,13378.04,80268.23,0,142.3279,0,16.45637,15.62782,16.04209,320.9079,1072745,0,0.5150819,0,0,0,0,0,0,3.716122,22.29673,0,0,48.44197,0,0,46.57433,0,0,47.31157"}, {hr="2", color_r="0", color_g="0", color_b="0", color_a="255", pos_x="0", pos_y="0", pos_z="0", is_surrogate="False", keys="zone people number of occupants [],zone people total heat gain [j],zone lights total heat gain [j],zone electric equipment total heat gain [j],zone window heat gain[w],zone window heat loss[w],zone transmitted solar energy[j],zone mean radiant temperature [c],zone mean air temperature [c],zone operative temperature [c],zone air balance surface convection rate [w],zone infiltration total heat loss [j],zone infiltration total heat gain [j],zone infiltration air change rate [ach],zone ventilation total heat loss [j],zone ventilation total heat gain [j],zone ventilation air change rate [ach],zone ventilation fan electric consumption [j],zonesys sensible heating energy [j],zonesys sensible cooling energy [j],lights : lights electric power [w],equip : electric equipment electric power [w],face_1_window_1 : window transmitted beam solar [w],face_1_window_1 : window heat gain [w],face_1_window_1 : window heat loss [w],face_1_window_2 : window transmitted beam solar [w],face_1_window_2 : window heat gain [w],face_1_window_2 : window heat loss [w],face_4_window_1 : window transmitted beam solar [w],face_4_window_1 : window heat gain [w],face_4_window_1 : window heat loss [w]", values="0,0,13378.04,80268.23,0,144.3923,0,16.30258,15.47177,15.88718,325.2617,1200062,0,0.5153424,0,0,0,0,0,0,3.716122,22.29673,0,0,49.10527,0,0,47.41046,0,0,47.87655"}, {hr="3", color_r="0", color_g="0", color_b="0", color_a="255", pos_x="0", pos_y="0", pos_z="0", is_surrogate="False", keys="zone people number of occupants [],zone people total heat gain [j],zone lights total heat gain [j],zone electric equipment total heat gain [j],zone window heat gain[w],zone window heat loss[w],zone transmitted solar energy[j],zone mean radiant temperature [c],zone mean air temperature [c],zone operative temperature [c],zone air balance surface convection rate [w],zone infiltration total heat loss [j],zone infiltration total heat gain [j],zone infiltration air change rate [ach],zone ventilation total heat loss [j],zone ventilation total heat gain [j],zone ventilation air change rate [ach],zone ventilation fan electric consumption [j],zonesys sensible heating energy [j],zonesys sensible cooling energy [j],lights : lights electric power [w],equip : electric equipment electric power [w],face_1_window_1 : window transmitted beam solar [w],face_1_window_1 : window heat gain [w],face_1_window_1 : window heat loss [w],face_1_window_2 : window transmitted beam solar [w],face_1_window_2 : window heat gain [w],face_1_window_2 : window heat loss [w],face_4_window_1 : window transmitted beam solar [w],face_4_window_1 : window heat gain [w],face_4_window_1 : window heat loss [w]", values="0,0,13378.04,80268.23,0,153.0734,0,16.14556,15.28362,15.71459,340.6429,1294398,0,0.5160303,0,0,0,0,0,0,3.716122,22.29673,0,0,52.15218,0,0,50.05907,0,0,50.86213"}, {hr="4", color_r="0", color_g="0", color_b="0", color_a="255", pos_x="0", pos_y="0", pos_z="0", is_surrogate="False", keys="zone people number of occupants [],zone people total heat gain [j],zone lights total heat gain [j],zone electric equipment total heat gain [j],zone window heat gain[w],zone window heat loss[w],zone transmitted solar energy[j],zone mean radiant temperature [c],zone mean air temperature [c],zone operative temperature [c],zone air balance surface convection rate [w],zone infiltration total heat loss [j],zone infiltration total heat gain [j],zone infiltration air change rate [ach],zone ventilation total heat loss [j],zone ventilation total heat gain [j],zone ventilation air change rate [ach],zone ventilation fan electric consumption [j],zonesys sensible heating energy [j],zonesys sensible cooling energy [j],lights : lights electric power [w],equip : electric equipment electric power [w],face_1_window_1 : window transmitted beam solar [w],face_1_window_1 : window heat gain [w],face_1_window_1 : window heat loss [w],face_1_window_2 : window transmitted beam solar [w],face_1_window_2 : window heat gain [w],face_1_window_2 : window heat loss [w],face_4_window_1 : window transmitted beam solar [w],face_4_window_1 : window heat gain [w],face_4_window_1 : window heat loss [w]", values="0,0,13378.04,80268.23,0,166.8406,0,15.98097,15.05174,15.51636,370.1736,1525565,0,0.5179785,0,0,0,0,51096.59,0,3.716122,22.29673,0,0,56.71199,0,0,54.9071,0,0,55.22155"}, {hr="5", color_r="0", color_g="0", color_b="0", color_a="255", pos_x="0", pos_y="0", pos_z="0", is_surrogate="False", keys="zone people number of occupants [],zone people total heat gain [j],zone lights total heat gain [j],zone electric equipment total heat gain [j],zone window heat gain[w],zone window heat loss[w],zone transmitted solar energy[j],zone mean radiant temperature [c],zone mean air temperature [c],zone operative temperature [c],zone air balance surface convection rate [w],zone infiltration total heat loss [j],zone infiltration total heat gain [j],zone infiltration air change rate [ach],zone ventilation total heat loss [j],zone ventilation total heat gain [j],zone ventilation air change rate [ach],zone ventilation fan electric consumption [j],zonesys sensible heating energy [j],zonesys sensible cooling energy [j],lights : lights electric power [w],equip : electric equipment electric power [w],face_1_window_1 : window transmitted beam solar [w],face_1_window_1 : window heat gain [w],face_1_window_1 : window heat loss [w],face_1_window_2 : window transmitted beam solar [w],face_1_window_2 : window heat gain [w],face_1_window_2 : window heat loss [w],face_4_window_1 : window transmitted beam solar [w],face_4_window_1 : window heat gain [w],face_4_window_1 : window heat loss [w]", values="0,0,13378.04,80268.23,0,171.3953,0,15.85267,15,15.42633,345.1413,1623084,0,0.5190707,0,0,0,0,261754.9,0,3.716122,22.29673,0,0,58.20883,0,0,56.54776,0,0,56.63875"}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])
zone_area = Panel("100")
python = PythonScript(hr_in=e_zone_1, area=zone_area)  # -> out, hr_out; disabled
# ---------- python: Python ----------
import clr
clr.AddReference("Dhour")
from DYear import DHr

i_gain = hr_in.val("zone infiltration total heat gain [j]")
i_loss = hr_in.val("zone infiltration total heat loss [j]")
v_gain = hr_in.val("zone ventilation total heat gain [j]")
v_loss = hr_in.val("zone ventilation total heat loss [j]")

hr_out = DHr(hr_in.hr)

people = hr_in.val("zone people total heat gain [j]")/(3600*area)
if (people>=0) : hr_out.put("people heat gain",people)
else : print "how can people be a loss?!"

lights = hr_in.val("zone lights total heat gain [j]")/(3600*area)
if (lights>=0) : hr_out.put("lights heat gain",lights)
else : print "how can lights be a loss?!"

equip = hr_in.val("zone electric equipment total heat gain [j]")/(3600*area)
if (equip>=0) : hr_out.put("equipment heat gain",equip)
else : print "how can equipment be a loss?!"

solar = hr_in.val("zone transmitted solar energy[j]")/(3600*area)
if (solar>=0) : hr_out.put("solar heat gain",solar)
else : print "how can solar be a loss?!"

vent = (i_gain - i_loss + v_gain - v_loss)/(3600*area)
if (vent>=0) : 
    hr_out.put("ventilation heat gain", vent)
    hr_out.put("ventilation heat loss", 0)
else :
    hr_out.put("ventilation heat gain", 0)
    hr_out.put("ventilation heat loss", vent)

envelope = hr_in.val("zone air balance surface convection rate [w]")/(1000*area)
if (envelope>=0) : 
    hr_out.put("envelope heat gain",envelope)
    hr_out.put("envelope heat loss", 0)
else :
    hr_out.put("envelope heat gain", 0)
    hr_out.put("envelope heat loss", envelope)
# ---------- end python ----------
gains_and_losses = DataHour([{hr="0", color_r="0", color_g="0", color_b="0", color_a="255", pos_x="0.0006849315", pos_y="0.3888889", pos_z="0", is_surrogate="False", keys="people heat gain,lights heat gain,equipment heat gain,solar heat gain,ventilation heat gain,ventilation heat loss,envelope heat gain,envelope heat loss", values="0,0.03716122,0.2229673,0,0,-3.111244,0.003336075,0"}, {hr="1", color_r="0", color_g="0", color_b="0", color_a="255", pos_x="0.002054794", pos_y="0.3888889", pos_z="0", is_surrogate="False", keys="people heat gain,lights heat gain,equipment heat gain,solar heat gain,ventilation heat gain,ventilation heat loss,envelope heat gain,envelope heat loss", values="0,0.03716122,0.2229673,0,0,-2.979847,0.003209079,0"}, {hr="2", color_r="0", color_g="0", color_b="0", color_a="255", pos_x="0.003424658", pos_y="0.3888889", pos_z="0", is_surrogate="False", keys="people heat gain,lights heat gain,equipment heat gain,solar heat gain,ventilation heat gain,ventilation heat loss,envelope heat gain,envelope heat loss", values="0,0.03716122,0.2229673,0,0,-3.333506,0.003252617,0"}, {hr="3", color_r="0", color_g="0", color_b="0", color_a="255", pos_x="0.00479452", pos_y="0.3888889", pos_z="0", is_surrogate="False", keys="people heat gain,lights heat gain,equipment heat gain,solar heat gain,ventilation heat gain,ventilation heat loss,envelope heat gain,envelope heat loss", values="0,0.03716122,0.2229673,0,0,-3.59555,0.003406429,0"}, {hr="4", color_r="0", color_g="0", color_b="0", color_a="255", pos_x="0.006164384", pos_y="0.3888889", pos_z="0", is_surrogate="False", keys="people heat gain,lights heat gain,equipment heat gain,solar heat gain,ventilation heat gain,ventilation heat loss,envelope heat gain,envelope heat loss", values="0,0.03716122,0.2229673,0,0,-4.23768,0.003701736,0"}, {hr="5", color_r="0", color_g="0", color_b="0", color_a="255", pos_x="0.007534246", pos_y="0.3888889", pos_z="0", is_surrogate="False", keys="people heat gain,lights heat gain,equipment heat gain,solar heat gain,ventilation heat gain,ventilation heat loss,envelope heat gain,envelope heat loss", values="0,0.03716122,0.2229673,0,0,-4.508567,0.003451413,0"}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])

# ----
# Note that ventilation heat gain contains some spikes that will throw off the scale of the resulting graph.  To correct this, we will set the scale manually.  To see what I mean, try disconnecting the scale.
all_gain_keys = Panel("""lights heat gain
people heat gain
equipment heat gain
solar heat gain
envelope heat gain
ventilation heat gain""")
# loss keys: envelope heat loss
# ventilation heat loss
gain_keys = Panel("""lights heat gain
equipment heat gain""")

# ---- group: weekly average
list = ValueList({"yearly", "monthly", "weekly", "daily"}, selected=[], ListIndex=2, UIMode=1)
stats = PeriodicStatistics(DHours=gains_and_losses, Period=list)  # -> MeanHours, ModeHours, HighHours, UpperQuartileHours, MedianHours, LowerQuartileHours, LowHours, SumHours

# ---- group: daily maximum
list_2 = ValueList({"yearly", "monthly", "weekly", "daily"}, selected=[], ListIndex=3, UIMode=1)
stats_2 = PeriodicStatistics(DHours=gains_and_losses, Period=list_2)  # -> MeanHours, ModeHours, HighHours, UpperQuartileHours, MedianHours, LowerQuartileHours, LowHours, SumHours

# ----
keys = String(gain_keys)
dom² = Domain²(DomainU="0 to 12", DomainV="0 to -1")
dom²_2 = Domain²(DomainU="0 to 12", DomainV="0 to 1")
pln = Plane(PlaneXY(0, 3, 0))
keys_2 = String(keys)
keys_3 = String(keys)

# ----
# Stacked
# Time-Value Graphs
stackedtimeval = StackedTimeValueSpatialization(DHours=stats_2.HighHours, Keys=all_gain_keys, Scale="0 to 20", Location=pln, GraphDimensions=dom²_2, BarWidth=1)  # -> DHours, Ranges, Positions, BasePoints, Regions
stackedtimeval_2 = StackedTimeValueSpatialization(DHours=stats.MeanHours, Keys=keys_3, Location=PlaneXY(0, 0, 0), GraphDimensions=dom², BarWidth=1)  # -> DHours, Ranges, Positions, BasePoints, Regions
stackedtimeval_3 = StackedTimeValueSpatialization(DHours=gains_and_losses, Keys=keys_2, Location=PlaneXY(0, 0, 0), BarWidth=1)  # -> DHours, Ranges, Positions, BasePoints, Regions

bang = ExplodeTree(Data=stackedtimeval_3.Positions)  # -> Branch0, Branch1, Branch2, Branch3, Branch4, Branch5
rec = Rectangle(stackedtimeval_2.Regions)
ranges = Panel(stackedtimeval_2.Ranges)
ranges_2 = Panel(stackedtimeval.Ranges)
pline = PolyLine(Vertices=bang.Branch0, Closed=False)
bang_2 = ExplodeTree(Data=stackedtimeval.Positions)  # -> Branch0, Branch1, Branch2, Branch3, Branch4, Branch5
pline_2 = PolyLine(Vertices=bang.Branch1, Closed=False)
mesh_pointlists = MeshPointlists(a_pts=stackedtimeval.BasePoints, b_pts=bang_2.Branch0, closed=False, color=ColourSwatch(SwatchColor=RGB(255, 255, 255)))
mesh_pointlists_2 = MeshPointlists(a_pts=bang_2.Branch1, b_pts=bang_2.Branch2, closed=False, color=ColourSwatch(SwatchColor=RGB(0, 0, 0)))
mesh_pointlists_3 = MeshPointlists(a_pts=bang_2.Branch0, b_pts=bang_2.Branch1, closed=False, color=ColourSwatch(SwatchColor=RGB(169, 163, 204)))
mesh_pointlists_4 = MeshPointlists(a_pts=bang_2.Branch2, b_pts=bang_2.Branch3, closed=False, color=ColourSwatch(SwatchColor=RGB(136, 131, 163)))
mesh_pointlists_5 = MeshPointlists(a_pts=bang_2.Branch3, b_pts=bang_2.Branch4, closed=False, color=ColourSwatch(SwatchColor=RGB(199, 0, 0)))
mesh_pointlists_6 = MeshPointlists(a_pts=bang_2.Branch4, b_pts=bang_2.Branch5, closed=False, color=ColourSwatch(SwatchColor=RGB(0, 13, 255)))
mesh = Mesh(mesh_pointlists)
mesh_2 = Mesh(mesh_pointlists_2)
mesh_3 = Mesh(mesh_pointlists_3)
mesh_4 = Mesh(mesh_pointlists_4)
mesh_5 = Mesh(mesh_pointlists_5)
mesh_6 = Mesh(mesh_pointlists_6)

# ==== cluster MeshPointlists
b_pts = ClusterInput()
a_pts = ClusterInput()
closed = ClusterInput()
b_pts_2 = Point(flatten(b_pts))
# all given lists should be of equal length
a_pts_2 = Point(flatten(a_pts))
closed_2 = Boolean(closed)
branch = TreeBranch(Tree=a_pts_2, Path="{0}", MaintainPaths=True)
lng = ListLength(List=branch)
i = Integer(expr("i+1", lng))
i_2 = Integer(expr("i-1", lng))
panel = Panel(lng)
i_3 = Integer(expr("i-1", lng))
i_4 = Integer(expr("i*2-1", lng))
panel_2 = Panel(i)
merge = Merge(Data1=a_pts_2, Data2=b_pts_2)
series = Series(Start=panel, Step=1, Count=i_2)
series_2 = Series(Start=panel_2, Step=1, Count=i_2)
series_3 = Series(Start="0", Step=1, Count=i_2)
series_4 = Series(Start="1", Step=1, Count=i_2)
panel_3 = Panel(i_3)
panel_4 = Panel(lng)
panel_5 = Panel(i_4)
quad = MeshQuad(CornerA=panel_3, CornerB="0", CornerC=panel_4, CornerD=panel_5)
quad_2 = MeshQuad(CornerA=series_3, CornerB=series_4, CornerC=series_2, CornerD=series)
color = ClusterInput()
face = MeshFace(flatten([quad_2, quad]))
face_2 = MeshFace(flatten(quad_2))
color_2 = Colour(color)
filter = StreamFilter(Gate=closed_2, Stream0=face_2, Stream1=face)
mesh = Mesh(Vertices=merge, Faces=filter, Colours=color_2)
panel_6 = Panel(filter)
msh = ClusterOutput(mesh)
