# Grasshopper definition spatialization - time-value.gh (Grasshopper 0.9.64)
# plug-ins: Dhour

oakland_epw = DataHour([{color_a="255", color_b="255", color_g="96", color_r="96", hr="0", is_surrogate="False", keys="et_rad_horz,et_rad_norm,global_horz_irrad,direct_norm_irrad,diffuse_horz_irrad,global_horz_illum,direct_norm_illum,diffuse_horz_illum,zenith_luminance,total_sky_cvr,opaque_sky_cvr,dry_bulb_temp,dew_point_temp,relative_humidity,pressure,wind_dir,wind_speed,horz_visibility,ceiling_height,precipt_water,aerosol_depth,snow_depth,days_since_snow,solar_altitude,solar_azimuth,sun_is_up,absolute_humidity", pos_x="1.001366", pos_y="-0.637647", pos_z="0", values="0,0,0,0,0,999900,999900,999900,99990,0,0,5.7,4.5,92,101430,40,1.9,24.1,77777,0,0,0,88,-1.309197,6.092528,0,655.0204"}, {color_a="255", color_b="255", color_g="83", color_r="83", hr="1", is_surrogate="False", keys="et_rad_horz,et_rad_norm,global_horz_irrad,direct_norm_irrad,diffuse_horz_irrad,global_horz_illum,direct_norm_illum,diffuse_horz_illum,zenith_luminance,total_sky_cvr,opaque_sky_cvr,dry_bulb_temp,dew_point_temp,relative_humidity,pressure,wind_dir,wind_speed,horz_visibility,ceiling_height,precipt_water,aerosol_depth,snow_depth,days_since_snow,solar_altitude,solar_azimuth,sun_is_up,absolute_humidity", pos_x="1.002736", pos_y="-0.6329412", pos_z="0", values="0,0,0,0,0,999900,999900,999900,99990,0,0,4.9,3.9,93,101230,30,2,24.1,77777,0,0,0,88,-1.257168,0.6658595,0,628.1306"}, {color_a="255", color_b="255", color_g="74", color_r="74", hr="2", is_surrogate="False", keys="et_rad_horz,et_rad_norm,global_horz_irrad,direct_norm_irrad,diffuse_horz_irrad,global_horz_illum,direct_norm_illum,diffuse_horz_illum,zenith_luminance,total_sky_cvr,opaque_sky_cvr,dry_bulb_temp,dew_point_temp,relative_humidity,pressure,wind_dir,wind_speed,horz_visibility,ceiling_height,precipt_water,aerosol_depth,snow_depth,days_since_snow,solar_altitude,solar_azimuth,sun_is_up,absolute_humidity", pos_x="1.004106", pos_y="-0.6235294", pos_z="0", values="0,0,0,0,0,999900,999900,999900,99990,0,0,4.4,3.6,95,101110,20,2.2,24.1,77777,0,0,0,88,-1.092806,1.136033,0,620.726"}, {color_a="255", color_b="255", color_g="69", color_r="69", hr="3", is_surrogate="False", keys="et_rad_horz,et_rad_norm,global_horz_irrad,direct_norm_irrad,diffuse_horz_irrad,global_horz_illum,direct_norm_illum,diffuse_horz_illum,zenith_luminance,total_sky_cvr,opaque_sky_cvr,dry_bulb_temp,dew_point_temp,relative_humidity,pressure,wind_dir,wind_speed,horz_visibility,ceiling_height,precipt_water,aerosol_depth,snow_depth,days_since_snow,solar_altitude,solar_azimuth,sun_is_up,absolute_humidity", pos_x="1.005476", pos_y="-0.6188235", pos_z="0", values="0,0,0,0,0,999900,999900,999900,99990,2,2,4.1,3.5,96,101060,10,2.3,24.1,77777,0,0,0,88,-0.8952814,1.392847,0,614.871"}, {color_a="255", color_b="255", color_g="73", color_r="73", hr="4", is_surrogate="False", keys="et_rad_horz,et_rad_norm,global_horz_irrad,direct_norm_irrad,diffuse_horz_irrad,global_horz_illum,direct_norm_illum,diffuse_horz_illum,zenith_luminance,total_sky_cvr,opaque_sky_cvr,dry_bulb_temp,dew_point_temp,relative_humidity,pressure,wind_dir,wind_speed,horz_visibility,ceiling_height,precipt_water,aerosol_depth,snow_depth,days_since_snow,solar_altitude,solar_azimuth,sun_is_up,absolute_humidity", pos_x="1.006846", pos_y="-0.6517647", pos_z="0", values="0,0,0,0,0,999900,999900,999900,99990,2,2,4.3,2.7,89,101090,27,2.4,24.1,77777,0,0,0,88,-0.6892139,1.57199,0,577.6714"}, {color_a="255", color_b="255", color_g="86", color_r="86", hr="5", is_surrogate="False", keys="et_rad_horz,et_rad_norm,global_horz_irrad,direct_norm_irrad,diffuse_horz_irrad,global_horz_illum,direct_norm_illum,diffuse_horz_illum,zenith_luminance,total_sky_cvr,opaque_sky_cvr,dry_bulb_temp,dew_point_temp,relative_humidity,pressure,wind_dir,wind_speed,horz_visibility,ceiling_height,precipt_water,aerosol_depth,snow_depth,days_since_snow,solar_altitude,solar_azimuth,sun_is_up,absolute_humidity", pos_x="1.008215", pos_y="-0.6752941", pos_z="0", values="0,0,0,0,0,999900,999900,999900,99990,2,2,5.1,2.7,84,101190,43,2.6,24.1,77777,0,0,0,88,-0.4829474,1.722077,0,574.8912"}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])
gradcolor2 = DoubleGradientColorization(
    DHours=oakland_epw,
    KeyA="dry_bulb_temp",
    DomainA="0 to 30",
    KeyB="relative_humidity",
    DomainB="0 to 100",
    AHighBHigh=RGB(255, 0, 0),
    AHighBLow=RGB(255, 255, 0),
    ALowBHigh=RGB(0, 0, 255),
    ALowBLow=RGB(255, 255, 255))  # -> DHours, Colors
colorized_hours = DataHour(gradcolor2.DHours)
colorized_hours_2 = DataHour(colorized_hours)
list = ValueList({"yearly", "monthly", "weekly", "daily"}, selected="yearly")
list_2 = ValueList({"monthly diurnal", "weekly diurnal"}, selected="monthly diurnal")
colorized_hours_3 = DataHour(colorized_hours)
pln = Plane(PlaneXY(1, 0, 0))
stats = PeriodicStatistics(DHours=colorized_hours_2, Period=list)  # -> MeanHours, ModeHours, HighHours, UpperQuantileHours, MedianHours, LowerQuantileHours, LowHours, SumHours
maskhours = MaskHours(DHours=colorized_hours_2, Hourmask="Dec 21 to Jun 21")
stats_2 = PeriodicStatistics(DHours=colorized_hours_3, Period=list_2)  # -> MeanHours, ModeHours, HighHours, UpperQuantileHours, MedianHours, LowerQuantileHours, LowHours, SumHours
slider = Slider(0.9, range=0..1)
# Simple Time-Value Graphs
panel = Panel("dry_bulb_temp")
dom² = Domain²(DomainU="0 to 12", DomainV="-2.0 to -1.1")
dom²_2 = Domain²(DomainU="0 to 12", DomainV="-1.0 to -0.6")
dom²_3 = Domain²(DomainU="0 to 12", DomainV="0.1 to 1.5")
dom²_4 = Domain²(DomainU="0 to 12", DomainV="-0.1 to -0.5")
dom²_5 = Domain²(DomainU="0 to 12", DomainV="0 to 2")
pln_2 = Plane(PlaneXY(1, -5, 0))

# ---- group: TV graphcs can plot unmasked yearly, monthly, weekly, daily summaries
timeval = TimeValueSpatialization(
    DHours=stats.MeanHours,
    Key="dry_bulb_temp",
    Domain="0 to 30",
    Location=pln,
    GraphDimensions=dom²,
    BarWidth=Slider(0.75, range=0..1))  # -> DHours, Positions, Rectangles

# ---- group: a TV graph for a partial year
timeval_2 = TimeValueSpatialization(DHours=maskhours, Key="relative_humidity", Location=pln, GraphDimensions=dom²_2, BarWidth=1)  # -> DHours, Positions, Rectangles

# ---- group: a TV graph for a full year
timeval_3 = TimeValueSpatialization(DHours=colorized_hours_2, Key=panel, Domain="0 to 30", Location=pln, GraphDimensions=dom²_3, BarWidth=1)  # -> DHours, Positions, Rectangles

# ---- group: an upside-down TV graph
timeval_4 = TimeValueSpatialization(DHours=colorized_hours_2, Key="relative_humidity", Domain="0 to 100", Location=pln, GraphDimensions=dom²_4, BarWidth=1)  # -> DHours, Positions, Rectangles

# ----
rec = Rectangle(timeval.Rectangles)
pt = Point(timeval.Positions)
rec_2 = Rectangle(timeval_2.Rectangles)
rec_3 = Rectangle(timeval_3.Rectangles)
pt_2 = Point(timeval_3.Positions)
rec_4 = Rectangle(timeval_4.Rectangles)
pt_3 = Point(timeval_4.Positions)
pline = PolyLine(Vertices=pt_2, Closed=False)
pline_2 = PolyLine(Vertices=pt_3, Closed=False)

# ---- group: setup some appropriate lineweights
getval = GetValue(Dhour=timeval.DHours, ValueKey="dry_bulb_temp")  # -> Value, Range
remap = RemapNumbers(Value=getval.Value, Source=getval.Range, Target=Domain(0, 1))  # -> Mapped, Clipped

# ---- group: labels
cluster = Cluster(pln=pln_2, domain="0 to 30", I=dom²_5)  # -> S, G, L
tag = TextTag(Location=cluster.G, Text=cluster.S)
line = Line(cluster.L)

# ----
# Diurnal Time-Value Graphs
diurnaltimeval = DiurnalTimeValueSpatialization(
    DHours=stats_2.MeanHours,
    Key="dry_bulb_temp",
    Domain="0 to 30",
    Location=pln_2,
    GraphDimensions=dom²_5,
    SubgraphWidth=slider)  # -> DHours, Positions, Rectangles
diurnaltimeval_2 = DiurnalTimeValueSpatialization(
    DHours=stats_2.UpperQuantileHours,
    Key="dry_bulb_temp",
    Domain="0 to 30",
    Location=pln_2,
    GraphDimensions=dom²_5,
    SubgraphWidth=slider)  # -> DHours, Positions, Rectangles
diurnaltimeval_3 = DiurnalTimeValueSpatialization(
    DHours=stats_2.LowerQuantileHours,
    Key="dry_bulb_temp",
    Domain="0 to 30",
    Location=pln_2,
    GraphDimensions=dom²_5,
    SubgraphWidth=slider)  # -> DHours, Positions, Rectangles

getcolor = GetColor(DHour=timeval.DHours)

# ---- group: explode pline into line segments
pline_3 = PolyLine(Vertices=pt, Closed=False)
explode = Explode(Curve=pline_3, Recursive=True)  # -> Segments, Vertices

# ----
pt_4 = Point(diurnaltimeval.Positions)
pt_5 = Point(diurnaltimeval_2.Positions)
pt_6 = Point(diurnaltimeval_3.Positions)
getcolor_2 = GetColor(DHour=diurnaltimeval_2.DHours)
getcolor_3 = GetColor(DHour=diurnaltimeval_3.DHours)
pline_4 = PolyLine(Vertices=pt_4, Closed=False)
mesh_pointlists = MeshPointlists(a_pts=pt_5, b_pts=pt_6, a_cols=getcolor_2, b_cols=getcolor_3, close=Toggle(False))
mesh = Mesh(mesh_pointlists)

# ==== cluster MeshPointlists
b_pts = ClusterInput()
a_pts = ClusterInput()
a_cols = ClusterInput()
b_cols = ClusterInput()
close = ClusterInput()
close_2 = Boolean(close)
b_pts_2 = Point(b_pts)
# all given lists should be of equal length
a_pts_2 = Point(a_pts)
a_cols_2 = Colour(a_cols)
b_cols_2 = Colour(b_cols)
branch = TreeBranch(Tree=a_pts_2, Path="{0}", MaintainPaths=True)
lng = ListLength(List=branch)
i = Integer(expr("i+1", lng))
panel = Panel(lng)
i_2 = Integer(expr("i-1", lng))
i_3 = Integer(expr("i*2-1", lng))
panel_2 = Panel(i)
merge = Merge(Data1=a_cols_2, Data2=b_cols_2)
merge_2 = Merge(Data1=a_pts_2, Data2=b_pts_2)
series = Series(Start=panel, Step=1, Count=23)
series_2 = Series(Start=panel_2, Step=1, Count=23)
series_3 = Series(Start="0", Step=1, Count=23)
series_4 = Series(Start="1", Step=1, Count=23)
panel_3 = Panel(i_2)
panel_4 = Panel(lng)
panel_5 = Panel(i_3)
quad = MeshQuad(CornerA=panel_3, CornerB="0", CornerC=panel_4, CornerD=panel_5)
quad_2 = MeshQuad(CornerA=series_3, CornerB=series_4, CornerC=series_2, CornerD=series)
face = MeshFace(flatten([quad_2, quad]))
face_2 = MeshFace(flatten(quad_2))
filter = StreamFilter(Gate=close_2, Stream0=face_2, Stream1=face)
mesh = Mesh(Vertices=merge_2, Faces=filter, Colours=merge)
panel_6 = Panel(filter)
msh = ClusterOutput(mesh)

# ==== cluster Cluster
pln = ClusterInput()
I = ClusterInput()
pln_2 = Plane(pln)
domain = ClusterInput()

# ---- group: labels for diurnal graph
slider = Slider(3, range=0..10)
dom = Domain²Components(Domain=I)  # -> UComponent, VComponent
domcomp = DomainComponents(Domain=dom.UComponent)  # -> Start, End
range = Range(Domain=dom.VComponent, Steps=slider)
domain_2 = Domain(domain)
range_2 = Range(Domain=domain_2, Steps=slider)
pt = PointOriented(BasePlane=pln_2, UComponent=domcomp.Start, VComponent=range, WComponent=0)
pt_2 = PointOriented(BasePlane=pln_2, UComponent=domcomp.End, VComponent=range, WComponent=0)
pcomp = PlaneComponents(Plane=pln_2)  # -> Origin, XAxis, YAxis, ZAxis
amp = Amplitude(Vector=pcomp.XAxis, Amplitude=expr("-A", Slider(0.89, range=0..10)))
format = Format(Format="{0} C", Data0=range_2)
ln = Line(StartPoint=pt, EndPoint=pt_2)
move = Move(Geometry=pt, Motion=amp)  # -> Geometry, Transform

# ----
S = ClusterOutput(format)
L = ClusterOutput(ln)
G = ClusterOutput(move.Geometry)
